# Grasshopper definition a-a-a-morph_atlas_multi_image.gh (Grasshopper 1.0.7)
# plug-ins: Human, Pufferfish, Moonlight

rectangle = Rectangle(Plane=PlaneXY(0, 0, 0), XSize="-.5 to .5", YSize="-.5 to .5", Radius=0)  # -> Rectangle, Length
explode = Explode(Curve=rectangle.Rectangle, Recursive=True)  # -> Segments, Vertices
panel = Panel("""1
0""")
cull = CullPattern(List=explode.Segments, CullPattern=invert(panel))
item = ListItem(List=cull, Index=0, Wrap=True)
flip = FlipCurve(Curve=cull, Guide=item)  # -> Curve, Flag
replace = ReplaceItems(List=flip.Curve, Item=item, Wrap=False)  # -> reverse(List)
number_slider = Slider(4, range=0..10)
loft = Loft(Curves=replace, Options={Adjust=False, Closed=False, LoftEnds=0, LoftSimp=0, LoftType=0, Rebuild=10, Refit=0.01})
srf = Surface(reparameterize(loft))
divide = DivideDomain²(Domain=srf, UCount=number_slider, VCount=number_slider)
subsrf = Isotrim(Surface=srf, Domain=divide)
panel_2 = Panel("C:\cWeb\projects\a-a-a\.system\images\")
lng = ListLength(List=subsrf)
series = Series(Start=0, Step=1, Count=lng)
smesh = SimpleMesh(Brep=subsrf)
dir = DirectoryContents(FolderPath=panel_2, Filter="*", IncludeSubfolders=False)  # -> FilePaths, FileNames
panel_3 = Panel("C:\cWeb\projects\a-a-a\.system\images\AP_0.jpg")
srf_2 = Surface(srf)
tri = Triangulate(Mesh=smesh)  # -> Mesh, Count
item_2 = ListItem(List=dir.FileNames, Index=series, Wrap=True)
lng_2 = ListLength(List=subsrf)
surfacemap = SurfaceMapping(Mesh=tri.Mesh, Surface=srf_2)
line = Line(Line((-0.003244691697, 0.6712461456, 0), (-0.003244691697, -0.6250537056, 0)))
concat = Concatenate(FragmentA=panel_2, FragmentB=item_2, FragmentC=".jpg")
scale_nu = ScaleNU(Geometry=line, Plane=PlaneXY(0, 0, 0), ScaleX=1, ScaleY=Slider(3.99, range=0..5), ScaleZ=1)  # -> Geometry, Transform
pt = Point(Point(-0.01636351536, -0.4828908037, 0))
mesh = Mesh(flatten(surfacemap))
divide_2 = DivideCurve(Curve=scale_nu.Geometry, Count=expr("x-1", lng_2), Kinks=False)  # -> Points, Tangents, Parameters
range = Range(Domain=Domain(0, 1), Steps=10)
area = Area(Geometry=mesh)  # -> Area, Centroid
xy = XYPlane(Origin=Point(0, 0, 0))
scale_nu_2 = ScaleNU(Geometry=tri.Mesh, Plane=pt, ScaleX="0.95", ScaleY=Slider(0.621, range=0..1), ScaleZ=1)  # -> Geometry, Transform
area_2 = Area(Geometry=mesh)  # -> Area, Centroid
graph = GraphMapper(range, x0=0, x1=1, y0=0, y1=1, container_name="Bezier", cpx=[0, 1, 0, 1], cpy=[0, 0, 1, 1])
vec2pt = Vector2Pt(PointA=area.Centroid, PointB=divide_2.Points, Unitize=False)  # -> Vector, Length
vec2pt_2 = Vector2Pt(PointA=xy, PointB=area_2.Centroid, Unitize=False)  # -> Vector, Length
pt_2 = Point(Point(0.4547361786, -0.2305927423, 0))
surfacemap_2 = SurfaceMapping(Mesh=scale_nu_2.Geometry, Surface=srf)
moonlight = Moonlight(Mode=Toggle(False))
surfacemap_3 = SurfaceMapping(Mesh=tri.Mesh, Surface=srf)
move = Move(Geometry=mesh, Motion=vec2pt.Vector)  # -> Geometry, Transform
scale = Scale(Geometry=vec2pt_2.Vector, Center=Point(0, 0, 0), Factor=Slider(0.2, range=0..1))  # -> Geometry, Transform
move_2 = Move(Geometry=mesh, Motion=scale.Geometry)  # -> Geometry, Transform
scale_2 = Scale(Geometry=move_2.Geometry, Center=pt_2, Factor=Slider(0.5, range=0..1))  # -> Geometry, Transform
previewmat = CustomPreviewMaterials(Geometry=graft(subsrf), DiffuseColor=RGB(255, 255, 255), DiffuseBitmap=graft(concat))
mjoin = MeshJoin(Meshes=surfacemap_2)  # -> flatten(Mesh)
mjoin_2 = MeshJoin(Meshes=surfacemap_3)  # -> flatten(Mesh)
previewmat_2 = CustomPreviewMaterials(
    Geometry=graft(mjoin_2),
    DiffuseColor=RGB(255, 255, 255),
    DiffuseBitmap=graft("C:\cWeb\projects\a-a-a\public\atlas\atlas.jpg"))
mjoin_3 = MeshJoin(Meshes=scale_2.Geometry)  # -> flatten(Mesh)
mjoin_4 = MeshJoin(Meshes=move.Geometry)  # -> flatten(Mesh)
entwine = Entwine(Branch00=mjoin, Branch01=mjoin_3, Branch02=mjoin_3, Branch03=mjoin_4, Branch04=mjoin_3, FlattenInputs=True)  # -> flatten(Result)
de_code_mesh = DeCodeMesh(m=entwine)  # -> F, V, C, N, UVs; inputs m: Mesh
# ---------- de_code_mesh: Python ----------
"""Extract Mesh UV coordinates
    Inputs:
        m: Mesh to extract UV coordinates from
    Output:
        F: List of faces
        V: List of vertices
        C: List of vertex colors, if they exist
        N: List of face normals, if they exist
        UVs: List of texture coordinates (UVs), if they exist"""

__author__ = "Nathan"
__version__ = "2018.07.20"

import rhinoscriptsyntax as rs

if not m==None:
    F = m.Faces
    V = m.Vertices
    N = m.FaceNormals
    C = m.VertexColors
    UVs = m.TextureCoordinates
# ---------- end de_code_mesh ----------
demesh = DeconstructMesh(Mesh=entwine)  # -> Vertices, Faces, Colours, Normals
tstat = TreeStatistics(Tree=de_code_mesh.F)  # -> Paths, Length, Count
item_3 = ListItem(List=tstat.Paths, Index=0, Wrap=True)
num = Number("5")
branch = TreeBranch(Tree=de_code_mesh.F, Path=item_3, MaintainPaths=True)
round_point = RoundPoint(data=demesh.Normals, data_2=num)
num_2 = Number("7")
pdecon = Deconstruct(Point=round_point)  # -> XComponent, YComponent, ZComponent
facetoarr = FaceToArr(T=branch)
tstat_2 = TreeStatistics(Tree=de_code_mesh.F)  # -> Paths, Length, Count
round_point_2 = RoundPoint(data=de_code_mesh.V, data_2=num_2)
series_2 = Series(Start=0, Step=1, Count=tstat_2.Count)
pdecon_2 = Deconstruct(Point=round_point_2)  # -> XComponent, YComponent, ZComponent
pdecon_3 = Deconstruct(Point=de_code_mesh.UVs)  # -> XComponent, YComponent, ZComponent
concat_2 = Concatenate(
    FragmentA=pdecon_2.XComponent,
    FragmentB=",",
    FragmentC=pdecon_2.YComponent,
    FragmentD=",",
    FragmentE=pdecon_2.ZComponent,
    FragmentF=",")
concat_3 = Concatenate(FragmentA=pdecon_3.XComponent, FragmentB=",", FragmentC=pdecon_3.YComponent, FragmentD=",")
concat_4 = Concatenate(
    FragmentA=pdecon.XComponent,
    FragmentB=",",
    FragmentC=pdecon.ZComponent,
    FragmentD=",",
    FragmentE=pdecon.YComponent,
    FragmentF=",")
join = TextJoin(Text=facetoarr)
join_2 = TextJoin(Text=concat_2)
join_3 = TextJoin(Text=concat_3)
join_4 = TextJoin(Text=concat_4)
concat_5 = Concatenate(FragmentA="position", FragmentB="_", FragmentC=series_2, FragmentD=":")  # -> graft(Result)
concat_6 = Concatenate(FragmentA="uv", FragmentB="_", FragmentC=series_2, FragmentD=":")  # -> graft(Result)
concat_7 = Concatenate(FragmentA="normal", FragmentB="_", FragmentC=series_2, FragmentD=":")  # -> graft(Result)
brec = BoundingRectangle(Geometry=flatten(srf), Plane=PlaneXY(0, 0, 0), Axis=0, Slide=0, Union=True)  # -> Bounding, DimensionX, DimensionY
concat_8 = Concatenate(FragmentA="indices:new Uint16Array(", FragmentB="[", FragmentC=join, FragmentD="]),")
concat_9 = Concatenate(FragmentA=concat_5, FragmentB="[", FragmentC=join_2, FragmentD="],")
concat_10 = Concatenate(FragmentA=concat_6, FragmentB="[", FragmentC=join_3, FragmentD="],")
concat_11 = Concatenate(FragmentA=concat_7, FragmentB="[", FragmentC=join_4, FragmentD="],")
panel_4 = Panel("2048")
gate = StreamGate(Stream=concat_11, Gate=0)  # -> Target0, Target1
concat_12 = Concatenate(FragmentB=concat_9, FragmentC=concat_10, FragmentJ=gate.Target0)
division = Division(A="4096", B=brec.DimensionX)
join_5 = TextJoin(Text=flatten(concat_8))  # -> simplify(Result)
join_6 = TextJoin(Text=flatten(concat_12))  # -> simplify(Result)
geo = Geometry(brec.Bounding)
concat_13 = Concatenate(FragmentC="export const morphData ={", FragmentA=join_5, FragmentB=join_6, FragmentD="}")
save = Button()
wrtietext = WrtieText(filePath="C:\cWeb\projects\a-a-a\src\data\morph_data.ts", data=concat_13, activate=Toggle(True))  # -> out, A; inputs data: list
# ---------- wrtietext: VB ----------
    If activate Then

      Dim i As Integer
      Dim aryText(4) As String

      aryText(0) = "Mary WriteLine"
      aryText(1) = "Had"
      aryText(2) = "Another"
      aryText(3) = "Little"
      aryText(4) = "One"

      ' the data is appended to the file. If file doesnt exist, a new file is created
      Dim objWriter As New System.IO.StreamWriter(filePath, append)

      For i = 0 To data.Count - 1
        objWriter.WriteLine(data(i))
      Next

      objWriter.Close()

    End If

    If clearFile Then
      Dim objWriter As New System.IO.StreamWriter(filePath, False)
      objWriter.Close()
    End If
# ---------- end wrtietext ----------

# ---- group: to save png double click clock to reset + set rhino viewport to top
clock = Clock(SecondHand=True)

# ----
moonlight_2 = Moonlight(Mode=Toggle(True))
python = GhPythonScript(frame=geo, factor=division, path="C:\cWeb\projects\a-a-a\.system\atlas\", filename="atlas", save=save)  # -> out; inputs frame: Polyline, save: Boolean
# ---------- python: Python ----------
import Rhino.Geometry as rg
import Rhino.Display as rd
import scriptcontext as sc
import System, operator

# Get x and y coordinates of frame vertices
px, py = set(frame.X), set(frame.Y)

# Get horizontal and vertical lengths
dx = abs(reduce(operator.sub, px))
dy = abs(reduce(operator.sub, py))

# Construct the points that will set the print area
offx = (dx/dy) * (3/factor)
offy = (dy/dx )* (3/factor)
p1 = rg.Point3d(min(px) + offx, min(py) + offy, 0)
p2 = rg.Point3d(max(px) - offx, max(py) - offy, 0)

# Set resolution to chosen scaling factor
sx, sy = dx*factor, dy*factor


def Capture():

    view = sc.doc.Views.ActiveView
    size = System.Drawing.Size(sx, sy) 

    settings = rd.ViewCaptureSettings(view, size, 300) #view, size, dpi
    settings.SetWindowRect(p1, p2)
    settings.RasterMode = True
    settings.DrawGrid = False
    settings.DrawAxis = False
    settings.DrawWallpaper = False

    bitmap = rd.ViewCapture.CaptureToBitmap(settings)
    bitmap.Save(path+filename+".jpg")


if save:
    Capture()
# ---------- end python ----------
output_path = Panel(python)
calendar = Calendar()
cdate = CombineDateTime(Date=calendar, Time=clock)
ddate = DeconstructDate(Date=cdate)  # -> Year, Month, Day, Hour, Minute, Second
concat_14 = Concatenate(
    FragmentA=ddate.Month,
    FragmentB="_",
    FragmentC=ddate.Day,
    FragmentD="_",
    FragmentE=ddate.Hour,
    FragmentG="_",
    FragmentF=ddate.Minute)

# ==== cluster RoundPoint
data = ClusterInput()
data_2 = ClusterInput()
data_3 = Data(data)
pdecon = Deconstruct(Point=data_3)  # -> XComponent, YComponent, ZComponent
data_4 = Data(data_2)
roundd = RoundToDecimalPlace(NumberX=pdecon.XComponent, DecimalPlace=data_4, RoundType=0)  # -> Rounded, Difference
roundd_2 = RoundToDecimalPlace(NumberX=pdecon.YComponent, DecimalPlace=data_4, RoundType=0)  # -> Rounded, Difference
roundd_3 = RoundToDecimalPlace(NumberX=pdecon.ZComponent, DecimalPlace=data_4, RoundType=0)  # -> Rounded, Difference
pt = ConstructPoint(XCoordinate=roundd.Rounded, YCoordinate=roundd_2.Rounded, ZCoordinate=roundd_3.Rounded)
pt_2 = ClusterOutput(pt)

# ==== cluster FaceToArr
T = ClusterInput()
rep = ReplaceText(Text=T, Find="T", RecursiveReplace=False)
rep_2 = ReplaceText(Text=rep, Find="{", RecursiveReplace=False)
rep_3 = ReplaceText(Text=rep_2, Find=";", Replace=",", RecursiveReplace=False)
rep_4 = ReplaceText(Text=rep_3, Find="}", Replace=",", RecursiveReplace=False)
R = ClusterOutput(rep_4)
